# Grasshopper definition calflab_example.gh (Grasshopper 1.0.8)

# Read me: CALFLAB example
# 1. Start the lab:  .\calflab.ps1 lab
# 2. GetDesign shows the genome and mass.
# 3. Move the slider, then switch 'apply' on: the gene changes in every client.
# 4. Press 'run': RunSim starts a simulation, GetMetrics polls it once a second.
# 5. Press 'bake': the design is built in the Rhino document (same as CalflabPull).
refresh = BooleanToggle(True)
getdesign = Python3Script(refresh=refresh)  # -> out, genome, mass_g, revision
# ---------- getdesign: Python ----------
import os, sys
sys.path.insert(0, os.path.dirname(ghenv.Component.OnPingDocument().FilePath))
import calflab_gh as gh
genome, mass_g, revision = gh.get_design(refresh)
# ---------- end getdesign ----------
shank_length = Slider(170, range=100..240)
apply = BooleanToggle(False)
run = Button()
runsim = Python3Script(run=run)  # -> out, job
# ---------- runsim: Python ----------
import os, sys
sys.path.insert(0, os.path.dirname(ghenv.Component.OnPingDocument().FilePath))
import calflab_gh as gh
job = gh.run_sim(run)
# ---------- end runsim ----------
getmetrics = Python3Script(job=runsim.job)  # -> out, status, metrics, run_id
# ---------- getmetrics: Python ----------
import os, sys
sys.path.insert(0, os.path.dirname(ghenv.Component.OnPingDocument().FilePath))
import calflab_gh as gh
status, metrics, run_id = gh.get_metrics(job)
# ---------- end getmetrics ----------
bake = Button()
baketorhino = Python3Script(bake=bake)  # -> out, summary
# ---------- baketorhino: Python ----------
import os, sys
sys.path.insert(0, os.path.dirname(ghenv.Component.OnPingDocument().FilePath))
import calflab_gh as gh
summary = gh.bake_to_rhino(bake)
# ---------- end baketorhino ----------
trigger = Trigger(Interval=1000, TimerInterval=1000, Target=getmetrics)
names = Panel("shank_length")
setgenomeparams = Python3Script(names=names, values=shank_length, apply=apply)  # -> out, revision; inputs names: list, values: list
# ---------- setgenomeparams: Python ----------
import os, sys
sys.path.insert(0, os.path.dirname(ghenv.Component.OnPingDocument().FilePath))
import calflab_gh as gh
revision = gh.set_genome_params(names, values) if apply else None
# ---------- end setgenomeparams ----------
genome = Panel(getdesign.genome)
mass_g = Panel(getdesign.mass_g)
summary = Panel(baketorhino.summary)
revision = Panel(setgenomeparams.revision)
status = Panel(getmetrics.status)
metrics = Panel(getmetrics.metrics)
